# Grasshopper definition TransformHint.gh (Grasshopper 1.0.7)

y_rotation = Slider(0.525, range=0..3.142)
cos = Cosine(Value=y_rotation)
sin = Sine(Value=y_rotation)
panel = Panel("""1
0
0
0
0
1
0
0
0
0
1
0
0
0
0
1""")
replace = ReplaceItems(List=panel, Item=cos, Indices=[0, 10], Wrap=False)
neg = Negative(Value=sin)
replace_2 = ReplaceItems(List=replace, Item=sin, Indices=2, Wrap=False)
replace_3 = ReplaceItems(List=replace_2, Item=neg, Indices=8, Wrap=False)
panel_2 = Panel("""1
0
0
.05
0
1
0
6
0
0
1
3
0
0
0
1""")
panel_3 = Panel(""".773
-.633
0
0
.633
.773
0
0
0
0
1
0
0
0
0
1""")
panel_4 = Panel(replace_3)
matrix = ConstructMatrix(Rows="4", Columns="4", Values=panel_3)
matrix_2 = ConstructMatrix(Rows="4", Columns="4", Values=panel_4)
matrix_3 = ConstructMatrix(Rows="4", Columns="4", Values=panel_2)
multiplication = Multiplication(A=matrix_3, B=matrix_2, C=matrix)
pt = ConstructPoint(XCoordinate=0, YCoordinate=0, ZCoordinate=0)
dematrix = DeconstructMatrix(Matrix=multiplication)  # -> Rows, Columns, Values
matrix_array = GetNumber(
    dematrix.Values,
    AtLeast=16,
    AtMost=16,
    Maximum=1.797693135e+308,
    Minimum=-1.797693135e+308,
    Prompt="Transform Matrix",
    TreeAccess=False)
gizmo_location = Point(pt)
scale = GetNumber(Slider(0.2, range=0..1), AtLeast=1, AtMost=1, Maximum=2, Minimum=0.1, TreeAccess=False)
number_slider = Slider(0.234, range=0..0.5)
matrix_4 = ConstructMatrix(Rows="4", Columns="4", Values=matrix_array)
matrix_5 = Matrix(multiplication)
pln = Plane(Plane(origin=(1.507708893, 4.303632312, 0), x=(0.9946917938, -0.1028991511, 0), y=(0.1028991511, 0.9946917938, 0)))
matrix_6 = TransformMatrix(matrix_4, Digits=3)
transform = Transform(Geometry=pln, Transform=matrix_5)
sph = Sphere(Base=gizmo_location, Radius=scale)
dematrix_2 = DeconstructMatrix(Matrix=matrix_6)  # -> Rows, Columns, Values

# ---- group: YZ Rotation
item = ListItem(List=dematrix_2.Values, Index=9, Wrap=True)
yz = YZPlane(Origin=Point(0, 0, 0))
rx = ArcSine(Value=item)
move = Move(Geometry=yz, Motion=gizmo_location)  # -> Geometry, Transform
arc = Arc(Plane=move.Geometry, Radius=1, Angle=rx)  # -> Arc, Length
end = EndPoints(Curve=arc.Arc)  # -> Start, End
multiplication_2 = Multiplication(A=arc.Length, B=scale)
multiplication_3 = Multiplication(A=multiplication_2, B=2)
division = Division(A=multiplication_2, B=2)
crv_cp = CurveClosestPoint(Point=end.End, Curve=arc.Arc)  # -> Point, Parameter, Distance
pframe = PerpFrame(Curve=arc.Arc, Parameter=crv_cp.Parameter)
cone = Cone(Base=pframe, Radius=multiplication_2, Length=multiplication_3)  # -> Cone, Tip
pipe = Pipe(Curve=arc.Arc, Radius=division, Caps=0)

# ---- group: X Translation
item_2 = ListItem(List=dematrix_2.Values, Index=3, Wrap=True)
min = Minimum(A=item_2, B=1)
neg_2 = Negative(Value=min)
X = UnitX(Factor=neg_2)
pt_2 = Point(gizmo_location)
move_2 = Move(Geometry=pt_2, Motion=X)  # -> Geometry, Transform
ln = Line(StartPoint=pt_2, EndPoint=move_2.Geometry)
len = Length(Curve=ln)
multiplication_4 = Multiplication(A=len, B=scale)
end_2 = EndPoints(Curve=ln)  # -> Start, End
multiplication_5 = Multiplication(A=multiplication_4, B=2)
division_2 = Division(A=multiplication_4, B=2)
pt_3 = Point(end_2.End)
crv_cp_2 = CurveClosestPoint(Point=pt_3, Curve=ln)  # -> Point, Parameter, Distance
pframe_2 = PerpFrame(Curve=ln, Parameter=crv_cp_2.Parameter)
cone_2 = Cone(Base=pframe_2, Radius=multiplication_4, Length=multiplication_5)  # -> Cone, Tip
pipe_2 = Pipe(Curve=ln, Radius=division_2, Caps=0)

# ---- group: XY Rotation
item_3 = ListItem(List=dematrix_2.Values, Index=4, Wrap=True)
xy = XYPlane(Origin=Point(0, 0, 0))
rz = ArcSine(Value=item_3)
move_3 = Move(Geometry=xy, Motion=gizmo_location)  # -> Geometry, Transform
arc_2 = Arc(Plane=move_3.Geometry, Radius=1, Angle=rz)  # -> Arc, Length
end_3 = EndPoints(Curve=arc_2.Arc)  # -> Start, End
multiplication_6 = Multiplication(A=arc_2.Length, B=scale)
pt_4 = Point(end_3.End)
multiplication_7 = Multiplication(A=multiplication_6, B=2)
division_3 = Division(A=multiplication_6, B=2)
crv_cp_3 = CurveClosestPoint(Point=pt_4, Curve=arc_2.Arc)  # -> Point, Parameter, Distance
pframe_3 = PerpFrame(Curve=arc_2.Arc, Parameter=crv_cp_3.Parameter)
cone_3 = Cone(Base=pframe_3, Radius=multiplication_6, Length=multiplication_7)  # -> Cone, Tip
pipe_3 = Pipe(Curve=arc_2.Arc, Radius=division_3, Caps=0)

# ---- group: Y Translation
item_4 = ListItem(List=dematrix_2.Values, Index=7, Wrap=True)
min_2 = Minimum(A=item_4, B=1)
neg_3 = Negative(Value=min_2)
pt_5 = Point(gizmo_location)
Y = UnitY(Factor=neg_3)
move_4 = Move(Geometry=pt_5, Motion=Y)  # -> Geometry, Transform
ln_2 = Line(StartPoint=pt_5, EndPoint=move_4.Geometry)
len_2 = Length(Curve=ln_2)
multiplication_8 = Multiplication(A=len_2, B=scale)
end_4 = EndPoints(Curve=ln_2)  # -> Start, End
multiplication_9 = Multiplication(A=multiplication_8, B=2)
division_4 = Division(A=multiplication_8, B=2)
pt_6 = Point(end_4.End)
crv_cp_4 = CurveClosestPoint(Point=pt_6, Curve=ln_2)  # -> Point, Parameter, Distance
pframe_4 = PerpFrame(Curve=ln_2, Parameter=crv_cp_4.Parameter)
cone_4 = Cone(Base=pframe_4, Radius=multiplication_8, Length=multiplication_9)  # -> Cone, Tip
pipe_4 = Pipe(Curve=ln_2, Radius=division_4, Caps=0)

# ---- group: XZ Rotation
item_5 = ListItem(List=dematrix_2.Values, Index=2, Wrap=True)
xz = XZPlane(Origin=Point(0, 0, 0))
ry = ArcSine(Value=item_5)
move_5 = Move(Geometry=xz, Motion=gizmo_location)  # -> Geometry, Transform
arc_3 = Arc(Plane=move_5.Geometry, Radius=1, Angle=ry)  # -> Arc, Length
end_5 = EndPoints(Curve=arc_3.Arc)  # -> Start, End
multiplication_10 = Multiplication(A=arc_3.Length, B=scale)
multiplication_11 = Multiplication(A=multiplication_10, B=2)
division_5 = Division(A=multiplication_10, B=2)
crv_cp_5 = CurveClosestPoint(Point=end_5.End, Curve=arc_3.Arc)  # -> Point, Parameter, Distance
pframe_5 = PerpFrame(Curve=arc_3.Arc, Parameter=crv_cp_5.Parameter)
cone_5 = Cone(Base=pframe_5, Radius=multiplication_10, Length=multiplication_11)  # -> Cone, Tip
pipe_5 = Pipe(Curve=arc_3.Arc, Radius=division_5, Caps=0)

# ---- group: Z Translation
item_6 = ListItem(List=dematrix_2.Values, Index=11, Wrap=True)
min_3 = Minimum(A=item_6, B=1)
neg_4 = Negative(Value=min_3)
pt_7 = Point(gizmo_location)
Z = UnitZ(Factor=neg_4)
move_6 = Move(Geometry=pt_7, Motion=Z)  # -> Geometry, Transform
ln_3 = Line(StartPoint=pt_7, EndPoint=move_6.Geometry)
len_3 = Length(Curve=ln_3)
multiplication_12 = Multiplication(A=len_3, B=scale)
end_6 = EndPoints(Curve=ln_3)  # -> Start, End
multiplication_13 = Multiplication(A=multiplication_12, B=2)
division_6 = Division(A=multiplication_12, B=2)
pt_8 = Point(end_6.End)
crv_cp_6 = CurveClosestPoint(Point=pt_8, Curve=ln_3)  # -> Point, Parameter, Distance
pframe_6 = PerpFrame(Curve=ln_3, Parameter=crv_cp_6.Parameter)
cone_6 = Cone(Base=pframe_6, Radius=multiplication_12, Length=multiplication_13)  # -> Cone, Tip
pipe_6 = Pipe(Curve=ln_3, Radius=division_6, Caps=0)

# ----
merge = Merge(
    Data1=cone.Cone,
    Data2=pipe,
    Data3=cone_5.Cone,
    Data4=pipe_5,
    Data5=cone_3.Cone,
    Data6=pipe_3,
    Data7=cone_2.Cone,
    Data8=pipe_2,
    Data9=cone_4.Cone,
    Data10=pipe_4,
    Data11=cone_6.Cone,
    Data12=pipe_6)
context_bake = ContextBake(Geometry=merge)
