# Grasshopper definition fologram_test4.gh (Grasshopper 1.0.7)
# plug-ins: FologramForGrasshopper, Fologram For Grasshopper Utilities

get_global = GetGlobalValue(IsDynamicUpdate=False)
connected_devices = ConnectedDevices(device_filter=3, hasSerializedData=True)
T = StateGate()  # -> True, False
track_markers = TrackMarkers(Device=connected_devices, hasSerializedData=True, marker_output_type=96, marker_trackable_size=45, update_mode=1)
device = TrackDevice(Device=connected_devices, hasSerializedData=True, update_mode=1)
panel = Panel(track_markers)
plane = Plane(track_markers)

pt = Point(<point referenced from the Rhino model>)
pt_2 = Point(<point referenced from the Rhino model>)
ln = Line(StartPoint=pt, EndPoint=pt_2)
vec2pt = Vector2Pt(PointA=pt, PointB=pt_2, Unitize=False)  # -> Vector, Length
X = UnitX(Factor=1)
geo = Geometry([<mesh referenced from the Rhino model> x2, <brep referenced from the Rhino model> x4])
pl = ConstructPlane(Origin=pt_2, XAxis=X, YAxis=vec2pt.Vector)
orient = Orient(Geometry=geo, Source=pl, Target=plane)  # -> Geometry, Transform

addition = Addition(A="22.5", B=Slider(60, range=0..100))
panel_2 = Panel(plane)
panel_3 = Panel("2")  # disabled
item = ListItem(List=plane, Index=panel_3, Wrap=True)  # disabled
set_global_value = SetGlobalValue(ArucoPlane=plane)  # disabled
set_global_value_2 = SetGlobalValue(ArucoPlane=plane)  # disabled
box = CenterBox(Base=plane, X="22.5", Y="22.5", Z="22.5")
number_slider = Slider(0, range=0..4)
box_2 = CenterBox(Base=item, X="22.5", Y="22.5", Z="22.5")  # disabled
line = LineSDL(Start=plane, Direction=plane, Length=addition)
end = EndPoints(Curve=line)  # -> Start, End
geo_2 = Geometry(<mesh referenced from the Rhino model>)
sync = SyncObject(
    GM=box_2,
    AlwaysIncludeTextureCoordinates=False,
    Clickable=False,
    DefaultCurveThicknessMillimeters=2.5,
    DefaultGlossPercent=0,
    DefaultMaterialColor=RGBA(46, 247, 15, 38),
    DefaultSpecularPercent=0,
    Grabbable=False,
    Interactive=False,
    Occlusion=False,
    Outline=True,
    hasSerializedData=True)  # disabled
vec2pt_2 = Vector2Pt(PointA=end.Start, PointB=end.End, Unitize=False)  # -> Vector, Length
geo_3 = Geometry(<mesh referenced from the Rhino model>)
item_2 = ListItem(List=orient.Geometry, Index=number_slider, Wrap=True)
panel_4 = Panel(item_2)
cull_i = CullIndex(List=orient.Geometry, Indices=number_slider, Wrap=True)
sync_2 = SyncObject(
    GM=box,
    AlwaysIncludeTextureCoordinates=False,
    Clickable=False,
    DefaultCurveThicknessMillimeters=2.5,
    DefaultGlossPercent=0,
    DefaultMaterialColor=RGBA(49, 80, 235, 215),
    DefaultSpecularPercent=0,
    Grabbable=False,
    Interactive=False,
    Occlusion=False,
    Outline=False,
    hasSerializedData=True)
move = Move(Geometry=geo_3, Motion=vec2pt_2.Vector)  # -> Geometry, Transform
sync_3 = SyncObject(
    GM=cull_i,
    AlwaysIncludeTextureCoordinates=False,
    Clickable=False,
    DefaultCurveThicknessMillimeters=2.5,
    DefaultGlossPercent=0,
    DefaultMaterialColor=RGBA(19, 54, 232, 116),
    DefaultSpecularPercent=0,
    Grabbable=False,
    Interactive=False,
    Occlusion=False,
    Outline=False,
    hasSerializedData=True)
panel_5 = Panel(orient.Geometry)
sync_4 = SyncObject(
    GM=item_2,
    AlwaysIncludeTextureCoordinates=False,
    Clickable=False,
    DefaultCurveThicknessMillimeters=2.5,
    DefaultGlossPercent=0,
    DefaultMaterialColor=RGBA(0, 247, 58, 32),
    DefaultSpecularPercent=0,
    Grabbable=False,
    Interactive=False,
    Occlusion=False,
    Outline=True,
    hasSerializedData=True)
srf = Surface(<surface referenced from the Rhino model>)  # disabled
pln = Plane(srf)  # disabled
line_2 = LineSDL(Start=pln, Direction=pln, Length=addition)  # disabled

pt_3 = Point(<point referenced from the Rhino model>)  # disabled
pt_4 = Point(<point referenced from the Rhino model>)  # disabled
ln_2 = Line(StartPoint=pt_3, EndPoint=pt_4)  # disabled
vec2pt_3 = Vector2Pt(PointA=pt_3, PointB=pt_4, Unitize=False)  # -> Vector, Length; disabled
X_2 = UnitX(Factor=1)  # disabled
geo_4 = Geometry(<mesh referenced from the Rhino model>)  # disabled
pl_2 = ConstructPlane(Origin=pt_4, XAxis=X_2, YAxis=vec2pt_3.Vector)  # disabled
orient_2 = Orient(Geometry=geo_4, Source=pl_2, Target=pln)  # -> Geometry, Transform; disabled

box_3 = CenterBox(Base=srf, X="22.5", Y="22.5", Z="22.5")  # disabled
end_2 = EndPoints(Curve=line_2)  # -> Start, End; disabled
vec2pt_4 = Vector2Pt(PointA=end_2.Start, PointB=end_2.End, Unitize=False)  # -> Vector, Length; disabled
move_2 = Move(Geometry=geo_4, Motion=vec2pt_4.Vector)  # -> Geometry, Transform; disabled
